# Grasshopper definition Grasshopper_Source_File.gh (Grasshopper 1.0.7)

# ----
# Input
size_height = Slider(0.4, range=0.1..10)
image_path = FilePath("C:\Users\sanch\Downloads\maze_9.png")
cylinder_radius = Slider(7.5, range=5..20)
thickness = Slider(2, range=-2..10)
print_angle = Slider(0.2, range=0..5)
size_width = Slider(3, range=1..10)
block_elevation = Slider(2, range=1..50)
img2maze = GhPythonScript(path=image_path)  # -> out, maze, mazeStr
# ---------- img2maze: Python ----------
import System
import rhinoscriptsyntax as rs

bitmap = System.Drawing.Bitmap.FromFile(path)
width = bitmap.Width
height = bitmap.Height
print(width)
print(height)
pixels = [[0] * width for i in range(height)]
maze = [[0] * width for i in range(height)]

for i in range(height):
    for j in range(width):
        pixelInfo = System.Drawing.Bitmap.GetPixel(bitmap, j, i)
        pixels[i][j] = pixelInfo
        if(pixelInfo[2] == 0):
            maze[i][j] = 'w'
        if(pixelInfo[2] != 0):
            maze[i][j] = 'c'
            

## Functions
def printMaze(maze):
    maze_str = ""
    for i in range(height):
        for j in range(width):
            maze_str += str(maze[i][j])+" "
        maze_str += "\n"
    return maze_str[:-1]
    
    
mazeStr = printMaze(maze)
# ---------- end img2maze ----------

maze2geometry = GhPythonScript(
    maze=img2maze.mazeStr,
    sizeWidth=size_width,
    sizeHeight=size_height,
    height=block_elevation,
    print3dangle=print_angle,
    base=thickness)  # -> out, geometry_out, maze_size_x, maze_size_y
# ---------- maze2geometry: Python ----------
__author__ = "sanchit gulati"
__version__ = "1"

import rhinoscriptsyntax as rs
import Rhino.Geometry as rg


lines = maze.split("\n")
letters = []
for i in range(0, len(lines)):
    letters.Add(lines[i].split(" ")[:-1])
maze_size_x = len(letters)
maze_size_y = len(letters[0])

len_y = len(letters)
len_x = len(letters[0])
breps = []
for i in range(len_y):
    for j in range(len_x):
        xValLeft = j*sizeWidth 
        XValRight = j*sizeWidth + sizeWidth
        yValTop = (len_y-i)*sizeHeight 
        yValBottom = (len_y-i)*sizeHeight - sizeHeight
        
        if letters[i][j] == 'c':
            arrPoint01 = rg.Point3d(xValLeft, yValBottom,0)
            arrPoint02 = rg.Point3d(xValLeft,yValTop,0)
            arrPoint03 = rg.Point3d(XValRight,yValTop,0)
            arrPoint04 = rg.Point3d(XValRight,yValBottom,0)
            line0 = rg.Polyline()
            line0.Add(arrPoint01)
            line0.Add(arrPoint02)
            line0.Add(arrPoint03)
            line0.Add(arrPoint04)
            line0.Add(arrPoint01)
            
            
            arrPoint11 = rg.Point3d(xValLeft, yValBottom,base)
            arrPoint12 = rg.Point3d(xValLeft,yValTop,base)
            arrPoint13 = rg.Point3d(XValRight,yValTop,base)
            arrPoint14 = rg.Point3d(XValRight,yValBottom,base)
            line1 = rg.Polyline()
            line1.Add(arrPoint11)
            line1.Add(arrPoint12)
            line1.Add(arrPoint13)
            line1.Add(arrPoint14)
            line1.Add(arrPoint11)
            loftComponent = rg.Extrusion.Create(line0.ToPolylineCurve(),-1*base,True).ToBrep()
            breps.append(loftComponent)
        
        elif letters[i][j] == 'w':
            
            arrPoint01 = rg.Point3d(xValLeft, yValBottom,0)
            arrPoint02 = rg.Point3d(xValLeft,yValTop,0)
            arrPoint03 = rg.Point3d(XValRight,yValTop,0)
            arrPoint04 = rg.Point3d(XValRight,yValBottom,0)
            line0 = rg.Polyline()
            line0.Add(arrPoint01)
            line0.Add(arrPoint02)
            line0.Add(arrPoint03)
            line0.Add(arrPoint04)
            line0.Add(arrPoint01)
            
            
            
            arrPoint11 = rg.Point3d(xValLeft, yValBottom,base)
            arrPoint12 = rg.Point3d(xValLeft,yValTop,base)
            arrPoint13 = rg.Point3d(XValRight,yValTop,base)
            arrPoint14 = rg.Point3d(XValRight,yValBottom,base)
            line1 = rg.Polyline()
            line1.Add(arrPoint11)
            line1.Add(arrPoint12)
            line1.Add(arrPoint13)
            line1.Add(arrPoint14)
            line1.Add(arrPoint11)
            
            
            
            arrPoint21 = rg.Point3d(xValLeft, yValBottom,height+base)
            arrPoint22 = rg.Point3d(xValLeft,yValTop,height+base)
            arrPoint23 = rg.Point3d(XValRight,yValTop,height+base)
            arrPoint24 = rg.Point3d(XValRight,yValBottom,height+base)
            
            if((i == len_y-1) or (i+1 < len_y and letters[i+1][j] == 'c')):
                arrPoint21 = rg.Point3d(xValLeft, yValBottom + print3dangle,height+base)
                arrPoint22 = rg.Point3d(xValLeft,yValTop,height+base)
                arrPoint23 = rg.Point3d(XValRight,yValTop,height+base)
                arrPoint24 = rg.Point3d(XValRight,yValBottom + print3dangle,height+base)
                
            
            line2 = rg.Polyline()
            line2.Add(arrPoint21)
            line2.Add(arrPoint22)
            line2.Add(arrPoint23)
            line2.Add(arrPoint24)
            line2.Add(arrPoint21)
            
            
            loftComponent = rg.Extrusion.Create(line0.ToPolylineCurve(),-1*base,True).ToBrep()
            loftComponent2 = rg.Brep.CreateFromLoftRebuild([line1.ToPolylineCurve(),line2.ToPolylineCurve()],rg.Point3d.Unset,rg.Point3d.Unset,rg.LoftType.Normal,False,1)
            singleList = []
            singleList.append(loftComponent)
            singleList.append(loftComponent2[0])
            final = rg.Brep.CreateBooleanUnion(singleList,0.1)
            breps.extend(final)

geometry_out = breps
# ---------- end maze2geometry ----------
cap_holes = CapHoles(Brep=maze2geometry.geometry_out)
multiplication = Multiplication(A=size_height, B=maze2geometry.maze_size_x)
multiplication_2 = Multiplication(A=maze2geometry.maze_size_y, B=size_width)
solid_union = SolidUnion(Breps=cap_holes)

# ----
# Mesh bounding box
box = DomainBox(Base=PlaneXY(0, 0, 0), X=multiplication_2, Y=multiplication, Z=thickness)

merge_faces = MergeFaces(Brep=solid_union)  # -> Breps, Before, After

# ----
# Bake and output wrapped geometry
cyl = Cylinder(Base=PlaneXY(0, 0, 0), Radius=cylinder_radius, Length=multiplication_2)
srfmorph = SurfaceMorph(Geometry=merge_faces.Breps, Reference=box, Surface=cyl, UDomain="2*pi", VDomain=multiplication_2, WDomain=thickness)

geometry = Geometry(srfmorph)
baker = Mesh(geometry)
custom_preview = CustomPreview(Geometry=baker, Material=ColourSwatch(SwatchColor=RGB(225, 255, 0)))
